# Grasshopper definition 231218_E-shape Plan.gh (Grasshopper 1.0.7)
# Copyright: SS
# plug-ins: CORE.Grasshopper.Colibri

range_and_step = ConstructDomain(DomainStart="2", DomainEnd="8")
range_and_step_2 = ConstructDomain(DomainStart="10", DomainEnd="20")
range_and_step_3 = ConstructDomain(DomainStart="15", DomainEnd="30")
range_and_step_4 = ConstructDomain(DomainStart="5", DomainEnd="9")
range_and_step_5 = ConstructDomain(DomainStart="10", DomainEnd="15")
normal_distribution = NormalDistribution(D=range_and_step, N="60", z="20000")
normal_distribution_2 = NormalDistribution(D=range_and_step_2, N="100", z="20000")
normal_distribution_3 = NormalDistribution(D=range_and_step_3, N="150", z="20000")
normal_distribution_4 = NormalDistribution(D=range_and_step_4, N="40", z="20000")
normal_distribution_5 = NormalDistribution(D=range_and_step_2, N="100", z="20000")
normal_distribution_6 = NormalDistribution(D=range_and_step_2, N="100", z="20000")
normal_distribution_7 = NormalDistribution(D=range_and_step_2, N="100", z="20000")
normal_distribution_8 = NormalDistribution(D=range_and_step_5, N="150", z="20000")
normal_distribution_9 = NormalDistribution(D=range_and_step_5, N="150", z="20000")
x = ListItem(List=normal_distribution_4, Index=0, Wrap=True)  # -> flatten(Item)
range_and_step_6 = ConstructDomain(DomainStart="1", DomainEnd="9")
normal_distribution_10 = NormalDistribution(D=range_and_step_6, N="8", z="20000")
range_and_step_7 = ConstructDomain(DomainStart=Slider(2.5, range=0..100), DomainEnd=Slider(3.5, range=0..100))
range_and_step_8 = ConstructDomain(DomainStart=Slider(0.1, range=0..100), DomainEnd=Slider(1, range=0..100))
range_and_step_9 = ConstructDomain(DomainStart=Slider(0.8, range=0..100), DomainEnd=Slider(2, range=0..100))
normal_distribution_11 = NormalDistribution(D=range_and_step_7, N=Slider(10, range=0..1000), z="20000")
normal_distribution_12 = NormalDistribution(D=range_and_step_8, N=Slider(9, range=0..1000), z="20000")
normal_distribution_13 = NormalDistribution(D=range_and_step_9, N=Slider(10, range=0..1000), z="20000")
division = Division(A=x, B=10)
x_2 = ListItem(List=normal_distribution_13, Index=0, Wrap=True)
wwr_axis = Panel(division)
staircasewidth = Slider(5, range=3..8)
staircase_distance = Slider(30, range=30..50)
corridor_threshold = Slider(10, range=8..12)
staircaseedge = Slider(2, range=1..10)
window_height = Panel(x_2)
number_slider = Slider(12, range=2..15)
hw2 = Slider(11, range=5..20)
hl2 = Slider(18, range=10..20)
hl1 = Slider(43, range=20..50)
vl1 = Slider(23, range=15..25)
wwr_xyaxis = Slider(0.7, range=-0.1..0.9)
hw1 = Slider(12, range=5..20)
vw1 = Slider(7, range=5..20)
hw2_2 = Panel("5")
corridorwidth = Panel("2")
index = Slider(2500, range=1501..2500)
vw3 = Slider(5, range=5..20)
hw3 = Slider(10, range=5..20)
vw2 = Slider(16, range=5..20)
vl2 = Slider(40, range=40..100)
colibri_in = ColibriInputsIterator(INDEX=index, ignoreAllWarningMsg=True)  # -> U, IP, INDEX, V_N
x_3 = ListItem(List=normal_distribution_2, Index=colibri_in.INDEX, Wrap=True)  # -> flatten(Item)
x_4 = ListItem(List=normal_distribution_3, Index=colibri_in.INDEX, Wrap=True)  # -> flatten(Item)
x_5 = ListItem(List=normal_distribution_5, Index=colibri_in.INDEX, Wrap=True)  # -> flatten(Item)
x_6 = ListItem(List=normal_distribution_6, Index=colibri_in.INDEX, Wrap=True)  # -> flatten(Item)
x_7 = ListItem(List=normal_distribution_7, Index=colibri_in.INDEX, Wrap=True)  # -> flatten(Item)
x_8 = ListItem(List=normal_distribution_9, Index=colibri_in.INDEX, Wrap=True)  # -> flatten(Item)
x_9 = ListItem(List=normal_distribution_8, Index=colibri_in.INDEX, Wrap=True)  # -> flatten(Item)
x_10 = ListItem(List=normal_distribution, Index=colibri_in.INDEX, Wrap=True)  # -> flatten(Item)
x_11 = ListItem(List=normal_distribution_10, Index=colibri_in.INDEX, Wrap=True)  # -> flatten(Item)
random = Random(Range=Domain(10, 20), Number=4, Seed=colibri_in.INDEX)  # -> flatten(Random)
random_2 = Random(Range=Domain(15, 40), Number=1, Seed=colibri_in.INDEX)  # -> flatten(Random)
random_3 = Random(Range=Domain(10, 20), Number=1, Seed=colibri_in.INDEX)  # -> flatten(Random)
random_4 = Random(Range=Domain(10, 15), Number=2, Seed=colibri_in.INDEX)  # -> flatten(Random)
random_5 = Random(Range=Domain(8, 12), Number=1, Seed=colibri_in.INDEX)  # -> flatten(Random)
random_6 = Random(Range=Domain(3, 8), Number=1, Seed=colibri_in.INDEX)  # -> flatten(Random)
random_7 = Random(Range=Domain(30, 50), Number=1, Seed=colibri_in.INDEX)  # -> flatten(Random)
random_8 = Random(Range=Domain(10, 60), Number=1, Seed=colibri_in.INDEX)  # -> flatten(Random)
random_9 = Random(Range=Domain(2, 8), Number=1, Seed=colibri_in.INDEX)  # -> flatten(Random)
random_10 = Random(Range=Domain(10, 20), Number=2, Seed=colibri_in.INDEX)  # -> flatten(Random)
random_11 = Random(Range=Domain(10, 20), Number=1, Seed=colibri_in.INDEX)  # -> flatten(Random)
random_12 = Random(Range=Domain(5, 9), Number=1, Seed=colibri_in.INDEX)  # -> flatten(Random)
random_13 = Random(Range=Domain(0, 2), Number=1, Seed=colibri_in.INDEX)  # -> flatten(Random)
random_14 = Random(Range=Domain(0, 360), Number=1, Seed=colibri_in.INDEX)  # -> flatten(Random)
random_15 = Random(Range=Domain(1, 7), Number=1, Seed=colibri_in.INDEX)  # -> flatten(Random)
int = Integer(random)
int_2 = Integer(random_4)
int_3 = Integer(random_8)
int_4 = Integer(random_10)
int_5 = Integer(random_2)
int_6 = Integer(random_11)
int_7 = Integer(random_5)
int_8 = Integer(random_12)
int_9 = Integer(random_3)
int_10 = Integer(random_9)
int_11 = Integer(random_6)
int_12 = Integer(random_7)
int_13 = Integer(random_13)
int_14 = Integer(random_14)
int_15 = Integer(x_11)
division_2 = Division(A=int_3, B=100)
division_3 = Division(A=int_6, B=10)
item = ListItem(List=int_4, Index=1, Wrap=True)
item_2 = ListItem(List=int_4, Index=0, Wrap=True)
x_12 = ListItem(List=normal_distribution_11, Index=colibri_in.INDEX, Wrap=True)
x_13 = ListItem(List=normal_distribution_12, Index=colibri_in.INDEX, Wrap=True)
hl2_2 = Panel(int_9)
apartmentwidth = Panel(x_10)
item_3 = ListItem(List=int, Index=0, Wrap=True)
hl1_2 = Panel(x_4)
item_4 = ListItem(List=int_2, Index=0, Wrap=True)
item_5 = ListItem(List=int_2, Index=1, Wrap=True)
item_6 = ListItem(List=int, Index=1, Wrap=True)
shading_type = Panel(int_13)
angle = Panel(int_14)
item_7 = ListItem(List=int, Index=2, Wrap=True)
item_8 = ListItem(List=int, Index=3, Wrap=True)
storey_number = Panel(int_15)
wall_u_value = Panel(division_2)
division_4 = Division(A=item, B=100)
window_u_value = Panel(division_3)
division_5 = Division(A=item_2, B=100)
storey_height = Panel(x_12)
shading_length = Panel(x_13)
hw1_2 = Panel(x_3)
vw2_2 = Panel(x_7)
vl2_2 = Panel(x_9)
floor_u_value = Panel(division_4)
roof_u_value = Panel(division_5)
vw1_2 = Panel(x_5)
vw3_2 = Panel(x_6)
vl1_2 = Panel(x_8)
staircasedistance = Panel(int_12)
staircasewidth_2 = Panel(int_11)
corridorthreshold = Panel(int_7)

addition = Addition(A=vw1_2, B=vl1_2, C=vw2_2)
addition_2 = Addition(A=hw1_2)
pt = ConstructPoint(XCoordinate=addition_2, YCoordinate=addition, ZCoordinate=0)
xy = XYPlane(Origin=pt)
prot = RotatePlane(Plane=xy, Angle=degrees(90))
buildingboundary = GhPythonScript(
    run=Toggle(True),
    startPlane=prot,
    buildingLength=vl2_2,
    buildingWidth=hw1_2,
    corridorThreshold=corridorthreshold,
    corridorWidth=corridorwidth,
    staircaseEdge=staircaseedge,
    staircaseWidth=staircasewidth_2,
    staircaseDistance=staircasedistance,
    apartmentWidth=apartmentwidth,
    WWR_XYaxis=wwr_axis)  # -> buildingBoundary, buildingVector, port, buildingCorridor, corridorEndPoints, port_2, staircaseBoundary, internalWall, port_3, windowSetPoints; inputs run: Boolean, startPlane: Plane
# ---------- buildingboundary: Python ----------
import Rhino.Geometry as rg
import rhinoscriptsyntax as rs
import math

def createBuilding(plane, length, width, threshold, corridorWidth, runComponent):
    if not runComponent:
        return None, None, None
        
    building = rg.Rectangle3d(plane, length, width)
    
    if width > threshold:
        start_point = plane.PointAt(0, width/2, 0)
        end_point = plane.PointAt(length, width/2, 0)
        double_wing = True
    
    else:
        start_point = plane.PointAt(0, width-corridorWidth/2, 0)
        end_point = plane.PointAt(length, width-corridorWidth/2, 0)
        double_wing = False

    corridor = rg.Line(start_point, end_point)
    
    return building, corridor, double_wing

#input points, staircase_edge, staircase_width, staircase_distance, corridor_width
def createStaircase(line, staircaseEdge, staircaseWidth, staircaseDistance):
    #define endpoints of corriodr
    start_point = line.From
    end_point = line.To
    corridor_endpoints =[start_point, end_point]
    
    #define the vectors
    vector_x = line.Direction
    vector_x.Unitize()
    vector_y = rs.VectorRotate(vector_x, 90, rg.Vector3d.ZAxis)
    
    #set the devide_points by staircasedistance
    points = []
    if line.Length - staircaseWidth > staircaseDistance:  
        start_offset_point = start_point + vector_x * (staircaseEdge + staircaseWidth/2)
        end_offset_point = end_point - vector_x * (staircaseEdge + staircaseWidth/2)
    
        distance = start_offset_point.DistanceTo(end_offset_point)
        num_points = int(math.ceil(distance / staircaseDistance))+1
        
        for i in range(num_points):
            d = distance / (num_points-1)
            point = start_offset_point + vector_x * d * i
            points.append(point)
    else:   # one staircase in the middle
        point = line.PointAt(0.5)
        points.append(point)
        
    #create staircase and all_points
    staircase = []
    allPoints = [start_point]
    
    for point in points:
        if double_wing:
            staircaseLength = 0.5 * buildingWidth
            A = rg.Point3d(point) - vector_x * staircaseWidth/2
            B = rg.Point3d(point) + vector_x * staircaseWidth/2 + vector_y * staircaseLength
            
        else:
            staircaseLength = 1 * buildingWidth
            A = rg.Point3d(point) - vector_x * staircaseWidth/2 - vector_y * (staircaseLength - corridorWidth/2)
            B = rg.Point3d(point) + vector_x * staircaseWidth/2 + vector_y * corridorWidth/2
            
        staircase_boundary = rg.Rectangle3d(startPlane, A, B)
        staircase.append(staircase_boundary)
        
        #create all points
        pt1 = rg.Point3d(point) - vector_x * staircaseWidth/2
        pt2 = rg.Point3d(point) + vector_x * staircaseWidth/2
        allPoints.append(pt1)
        allPoints.append(pt2)
    allPoints.append(end_point)

    return staircase, vector_x, corridor_endpoints, allPoints

def createInternalWall_Window(apartmentWidth, allPoints, vector_x, buildingWidth, WWR_XYaxis):
    walls = []
    wall_points = []
    windows = []
    vector_y = rs.VectorRotate(vector_x, 90, rg.Vector3d.ZAxis)
    
    #internal wall
    for i in range(0, len(allPoints)-1, 2):
        distance = allPoints[i].DistanceTo(allPoints[i+1])
        num_points = int(math.ceil(distance / apartmentWidth))+1
        
        for j in range(num_points):
            d = distance / (num_points-1)
            wall_point = allPoints[i] + vector_x * d * j
            wall_points.append(wall_point)
            
            
            if double_wing:
                pt1 = wall_point + vector_y * buildingWidth/2
                pt2 = wall_point - vector_y * buildingWidth/2
            else:
                pt1 = wall_point + vector_y * corridorWidth/2
                pt2 = wall_point - vector_y * (buildingWidth - corridorWidth/2)
            wall = rg.Line(pt1, pt2)
            
            walls.append(wall)
            InternalWalls = walls[1:-1]
    
   #window set points
    for i in range(0, len(wall_points)-1):
        distance = wall_points[i].DistanceTo(wall_points[i+1])
        window_point = wall_points[i] + vector_x * distance/2
        
        if double_wing:
            pt1A = window_point + vector_y * buildingWidth/2 - vector_x * WWR_XYaxis/2 * distance
            pt1B = window_point + vector_y * buildingWidth/2 + vector_x * WWR_XYaxis/2 * distance
            window =rg.Line(pt1A, pt1B)
            windows.append(window)
            
            pt2A = window_point - vector_y * buildingWidth/2 - vector_x * WWR_XYaxis/2 * distance
            pt2B = window_point - vector_y * buildingWidth/2 + vector_x * WWR_XYaxis/2 * distance
            window =rg.Line(pt2A, pt2B)
            windows.append(window)

        else:
            pt1A = window_point + vector_y * corridorWidth/2 - vector_x * WWR_XYaxis/2 * distance
            pt1B = window_point + vector_y * corridorWidth/2 + vector_x * WWR_XYaxis/2 * distance
            window =rg.Line(pt1A, pt1B)
            windows.append(window)
            
            pt2A = window_point - vector_y * (buildingWidth - corridorWidth/2) - vector_x * WWR_XYaxis/2 * distance
            pt2B = window_point - vector_y * (buildingWidth - corridorWidth/2) + vector_x * WWR_XYaxis/2 * distance
            window =rg.Line(pt2A, pt2B)
            windows.append(window)

    return InternalWalls, windows


#create
buildingBoundary, buildingCorridor, double_wing = createBuilding(startPlane, buildingLength, buildingWidth, corridorThreshold, corridorWidth, run)

staircaseBoundary, buildingVector, corridorEndPoints, allPoints = createStaircase(buildingCorridor, staircaseEdge, staircaseWidth, staircaseDistance)

internalWall, windowSetPoints = createInternalWall_Window(apartmentWidth, allPoints, buildingVector, buildingWidth, WWR_XYaxis)
# ---------- end buildingboundary ----------
dispatch = Dispatch(List=buildingboundary.windowSetPoints, DispatchPattern=[True, False])  # -> ListA, ListB

addition_3 = Addition(A=vw1_2)
addition_4 = Addition(A=hw1_2)
pt_2 = ConstructPoint(XCoordinate=addition_4, YCoordinate=addition_3, ZCoordinate=0)
xy_2 = XYPlane(Origin=pt_2)
prot_2 = RotatePlane(Plane=xy_2, Angle=degrees(90))
buildingboundary_2 = GhPythonScript(
    run=Toggle(True),
    startPlane=prot_2,
    buildingLength=vl1_2,
    buildingWidth=hw1_2,
    corridorThreshold=corridorthreshold,
    corridorWidth=corridorwidth,
    staircaseEdge=staircaseedge,
    staircaseWidth=staircasewidth_2,
    staircaseDistance=staircasedistance,
    apartmentWidth=apartmentwidth,
    WWR_XYaxis=wwr_axis)  # -> buildingBoundary, buildingVector, port, buildingCorridor, corridorEndPoints, port_2, staircaseBoundary, internalWall, port_3, windowSetPoints; inputs run: Boolean, startPlane: Plane; same code as buildingboundary
dispatch_2 = Dispatch(List=buildingboundary_2.windowSetPoints, DispatchPattern=[True, False])  # -> ListA, ListB

panel = Panel("C:\Users\xinyuew\OneDrive - Chalmers\haohaoxuexi\shits for paper No.2\colibri\first1000\E\second part")

pt_3 = ConstructPoint(XCoordinate=hw1_2, YCoordinate=0, ZCoordinate=0)
xy_3 = XYPlane(Origin=pt_3)
buildingboundary_3 = GhPythonScript(
    run=Toggle(True),
    startPlane=xy_3,
    buildingLength=hl1_2,
    buildingWidth=vw1_2,
    corridorThreshold=corridorthreshold,
    corridorWidth=corridorwidth,
    staircaseEdge=staircaseedge,
    staircaseWidth=staircasewidth_2,
    staircaseDistance=staircasedistance,
    apartmentWidth=apartmentwidth,
    WWR_XYaxis=wwr_axis)  # -> buildingBoundary, buildingVector, port, buildingCorridor, corridorEndPoints, port_2, staircaseBoundary, internalWall, port_3, windowSetPoints; inputs run: Boolean, startPlane: Plane; same code as buildingboundary
dispatch_3 = Dispatch(List=buildingboundary_3.windowSetPoints, DispatchPattern=[True, False])  # -> ListA, ListB

addition_5 = Addition(A=vw1_2, B=vl1_2, C=vw2_2, D=vl2_2)
addition_6 = Addition(A=hw1_2)
pt_4 = ConstructPoint(XCoordinate=addition_6, YCoordinate=addition_5, ZCoordinate=0)
xy_4 = XYPlane(Origin=pt_4)
buildingboundary_4 = GhPythonScript(
    run=Toggle(True),
    startPlane=xy_4,
    buildingLength=hl1_2,
    buildingWidth=vw3_2,
    corridorThreshold=corridorthreshold,
    corridorWidth=corridorwidth,
    staircaseEdge=staircaseedge,
    staircaseWidth=staircasewidth_2,
    staircaseDistance=staircasedistance,
    apartmentWidth=apartmentwidth,
    WWR_XYaxis=wwr_axis)  # -> buildingBoundary, buildingVector, port, buildingCorridor, corridorEndPoints, port_2, staircaseBoundary, internalWall, port_3, windowSetPoints; inputs run: Boolean, startPlane: Plane; same code as buildingboundary
dispatch_4 = Dispatch(List=buildingboundary_4.windowSetPoints, DispatchPattern=[True, False])  # -> ListA, ListB

addition_7 = Addition(A=vw1_2, B=vl1_2)
addition_8 = Addition(A=hw1_2)
pt_5 = ConstructPoint(XCoordinate=addition_8, YCoordinate=addition_7, ZCoordinate=0)
xy_5 = XYPlane(Origin=pt_5)
buildingboundary_5 = GhPythonScript(
    run=Toggle(True),
    startPlane=xy_5,
    buildingLength=hl1_2,
    buildingWidth=vw2_2,
    corridorThreshold=corridorthreshold,
    corridorWidth=corridorwidth,
    staircaseEdge=staircaseedge,
    staircaseWidth=staircasewidth_2,
    staircaseDistance=staircasedistance,
    apartmentWidth=apartmentwidth,
    WWR_XYaxis=wwr_axis)  # -> buildingBoundary, buildingVector, port, buildingCorridor, corridorEndPoints, port_2, staircaseBoundary, internalWall, port_3, windowSetPoints; inputs run: Boolean, startPlane: Plane; same code as buildingboundary
dispatch_5 = Dispatch(List=buildingboundary_5.windowSetPoints, DispatchPattern=[True, False])  # -> ListA, ListB

type = Panel("E")

# ---- group: grid
python = GhPythonScript(HW1=hw1_2, HL1=hl1_2, HW2=hw2_2, HL2=hl2_2, HW3=hw3, VW1=vw1_2, VL1=vl1_2, VW2=vw2_2, VL2=vl2_2, VW3=vw3_2)  # -> out, a
# ---------- python: Python ----------
import Rhino.Geometry as rg

# Inputs are HW1, HL1, HW2, HL2, HW3, VW1, VL1, VW2, VL2, VW3
# These should be provided to the script component as floating point numbers

# Initialize the starting point
start_point = rg.Point3d(0, 0, 0)

# Initialize lists to hold the grid lines
vertical_lines = []
horizontal_lines = []

# Calculate the positions of the vertical lines and add them to the list
current_x = 0
for width in [HW1, HL1, HW2, HL2, HW3]:
    current_x += width
    pt1 = rg.Point3d(current_x, 0, 0)
    pt2 = rg.Point3d(current_x, VW1 + VL1 + VW2 + VL2 + VW3, 0)
    vertical_lines.append(rg.Line(pt1, pt2))

# Calculate the positions of the horizontal lines and add them to the list
current_y = 0
for width in [VW1, VL1, VW2, VL2, VW3]:
    current_y += width
    pt1 = rg.Point3d(0, current_y, 0)
    pt2 = rg.Point3d(HW1 + HL1 + HW2 + HL2 + HW3, current_y, 0)
    horizontal_lines.append(rg.Line(pt1, pt2))

# Combine the lines into a single list to output
grid_lines = vertical_lines + horizontal_lines

# Output
a = grid_lines
# ---------- end python ----------

# ----
python_2 = GhPythonScript(HW1=hw1_2, HL1=hl1_2, HW2=hw2_2, HL2=hl2_2, HW3=hw3, VW1=vw1_2, VL1=vl1_2, VW2=vw2_2, VL2=vl2_2, VW3=vw3_2)  # -> joint
# ---------- python_2: Python ----------
import Rhino.Geometry as rg

# Inputs are HW1, HL1, HW2, HL2, HW3, VW1, VL1, VW2, VL2, VW3
# These should be provided to the script component as floating point numbers

# Function to create a rectangle
def create_rectangle(width, height, base_point):
    # Define the corners of the rectangle
    bottom_left = base_point
    bottom_right = rg.Point3d(base_point.X + width, base_point.Y, base_point.Z)
    top_right = rg.Point3d(base_point.X + width, base_point.Y + height, base_point.Z)
    top_left = rg.Point3d(base_point.X, base_point.Y + height, base_point.Z)
    
    # Create a closed polyline that represents the rectangle
    rectangle_corners = [bottom_left, bottom_right, top_right, top_left, bottom_left]
    rectangle = rg.Polyline(rectangle_corners)
    return rectangle

# Initialize lists to hold the rectangles
rectangles = []

# Calculate the positions of the rectangles and add them to the list
current_x = 0
for i, hw in enumerate([HW1, HW2, HW3]):
    # Skip the first space as there's no rectangle at the start
    if i > 0:
        current_x += eval('HL' + str(i))
    base_x = current_x
    
    current_y = 0
    for j, vw in enumerate([VW1, VW2, VW3]):
        # Skip the first space as there's no rectangle at the start
        if j > 0:
            current_y += eval('VL' + str(j))
        base_y = current_y
        
        # Base point for the current rectangle
        base_point = rg.Point3d(base_x, base_y, 0)
        
        # Add the current rectangle to the list
        rectangles.append(create_rectangle(eval('HW' + str(i + 1)), eval('VW' + str(j + 1)), base_point))
        
        # Update the y position for the next rectangle in the column
        current_y += eval('VW' + str(j + 1))

    # Update the x position for the next rectangle in the row
    current_x += eval('HW' + str(i + 1))

# Output
joint = rectangles
# ---------- end python_2 ----------

addition_9 = Addition(A=vw1_2, B=vl1_2, C=vw2_2)
addition_10 = Addition(A=hw1_2, B=hl1_2, C=hw2_2)
pt_6 = ConstructPoint(XCoordinate=addition_10, YCoordinate=addition_9, ZCoordinate=0)
xy_6 = XYPlane(Origin=pt_6)
prot_3 = RotatePlane(Plane=xy_6, Angle=degrees(90))
buildingboundary_6 = GhPythonScript(
    run=Toggle(False),
    startPlane=prot_3,
    buildingLength=vl2_2,
    buildingWidth=hw2_2,
    corridorThreshold=corridorthreshold,
    corridorWidth=corridorwidth,
    staircaseEdge=staircaseedge,
    staircaseWidth=staircasewidth_2,
    staircaseDistance=staircasedistance,
    apartmentWidth=apartmentwidth,
    WWR_XYaxis=wwr_axis)  # -> buildingBoundary, buildingVector, port, buildingCorridor, corridorEndPoints, port_2, staircaseBoundary, internalWall, port_3, windowSetPoints; inputs run: Boolean, startPlane: Plane; same code as buildingboundary
dispatch_6 = Dispatch(List=buildingboundary_6.windowSetPoints, DispatchPattern=[True, False])  # -> ListA, ListB

addition_11 = Addition(A=vw1_2)
addition_12 = Addition(A=hw1_2, B=hl1_2, C=hw2_2)
pt_7 = ConstructPoint(XCoordinate=addition_12, YCoordinate=addition_11, ZCoordinate=0)
xy_7 = XYPlane(Origin=pt_7)
prot_4 = RotatePlane(Plane=xy_7, Angle=degrees(90))
buildingboundary_7 = GhPythonScript(
    run=Toggle(False),
    startPlane=prot_4,
    buildingLength=vl1_2,
    buildingWidth=hw2_2,
    corridorThreshold=corridorthreshold,
    corridorWidth=corridorwidth,
    staircaseEdge=staircaseedge,
    staircaseWidth=staircasewidth_2,
    staircaseDistance=staircasedistance,
    apartmentWidth=apartmentwidth,
    WWR_XYaxis=wwr_axis)  # -> buildingBoundary, buildingVector, port, buildingCorridor, corridorEndPoints, port_2, staircaseBoundary, internalWall, port_3, windowSetPoints; inputs run: Boolean, startPlane: Plane; same code as buildingboundary
dispatch_7 = Dispatch(List=buildingboundary_7.windowSetPoints, DispatchPattern=[True, False])  # -> ListA, ListB

addition_13 = Addition(A=vw1_2, B=vl1_2)
addition_14 = Addition(A=hw1_2, B=hl1_2, C=hw2_2)
pt_8 = ConstructPoint(XCoordinate=addition_14, YCoordinate=addition_13, ZCoordinate=0)
xy_8 = XYPlane(Origin=pt_8)
buildingboundary_8 = GhPythonScript(
    run=Toggle(False),
    startPlane=xy_8,
    buildingLength=hl2_2,
    buildingWidth=vw2_2,
    corridorThreshold=corridorthreshold,
    corridorWidth=corridorwidth,
    staircaseEdge=staircaseedge,
    staircaseWidth=staircasewidth_2,
    staircaseDistance=staircasedistance,
    apartmentWidth=apartmentwidth,
    WWR_XYaxis=wwr_axis)  # -> buildingBoundary, buildingVector, port, buildingCorridor, corridorEndPoints, port_2, staircaseBoundary, internalWall, port_3, windowSetPoints; inputs run: Boolean, startPlane: Plane; same code as buildingboundary
dispatch_8 = Dispatch(List=buildingboundary_8.windowSetPoints, DispatchPattern=[True, False])  # -> ListA, ListB

addition_15 = Addition(A=hw1_2, B=hl1_2, C=hw2_2)
pt_9 = ConstructPoint(XCoordinate=addition_15, YCoordinate=0, ZCoordinate=0)
xy_9 = XYPlane(Origin=pt_9)
buildingboundary_9 = GhPythonScript(
    run=Toggle(False),
    startPlane=xy_9,
    buildingLength=hl2_2,
    buildingWidth=vw1_2,
    corridorThreshold=corridorthreshold,
    corridorWidth=corridorwidth,
    staircaseEdge=staircaseedge,
    staircaseWidth=staircasewidth_2,
    staircaseDistance=staircasedistance,
    apartmentWidth=apartmentwidth,
    WWR_XYaxis=wwr_axis)  # -> buildingBoundary, buildingVector, port, buildingCorridor, corridorEndPoints, port_2, staircaseBoundary, internalWall, port_3, windowSetPoints; inputs run: Boolean, startPlane: Plane; same code as buildingboundary
dispatch_9 = Dispatch(List=buildingboundary_9.windowSetPoints, DispatchPattern=[True, False])  # -> ListA, ListB

addition_16 = Addition(A=vw1_2, B=vl1_2, C=vw2_2, D=vl2_2)
addition_17 = Addition(A=hw1_2, B=hl1_2, C=hw2_2)
pt_10 = ConstructPoint(XCoordinate=addition_17, YCoordinate=addition_16, ZCoordinate=0)
xy_10 = XYPlane(Origin=pt_10)
buildingboundary_10 = GhPythonScript(
    run=Toggle(False),
    startPlane=xy_10,
    buildingLength=hl2_2,
    buildingWidth=vw3_2,
    corridorThreshold=corridorthreshold,
    corridorWidth=corridorwidth,
    staircaseEdge=staircaseedge,
    staircaseWidth=staircasewidth_2,
    staircaseDistance=staircasedistance,
    apartmentWidth=apartmentwidth,
    WWR_XYaxis=wwr_axis)  # -> buildingBoundary, buildingVector, port, buildingCorridor, corridorEndPoints, port_2, staircaseBoundary, internalWall, port_3, windowSetPoints; inputs run: Boolean, startPlane: Plane; same code as buildingboundary
dispatch_10 = Dispatch(List=buildingboundary_10.windowSetPoints, DispatchPattern=[True, False])  # -> ListA, ListB

merge = Merge(
    Data1=buildingboundary.corridorEndPoints,
    Data2=buildingboundary_2.corridorEndPoints,
    Data3=buildingboundary_4.corridorEndPoints,
    Data4=buildingboundary_5.corridorEndPoints,
    Data5=buildingboundary_3.corridorEndPoints,
    Data6=buildingboundary_6.corridorEndPoints,
    Data7=buildingboundary_7.corridorEndPoints,
    Data8=buildingboundary_10.corridorEndPoints,
    Data9=buildingboundary_8.corridorEndPoints,
    Data10=buildingboundary_9.corridorEndPoints)

# ---- group: joint
python_3 = GhPythonScript(endPoints=merge, joint=python_2)  # -> flatten(jointCorridor), jointBoundary; inputs endPoints: list of Point3d, joint: list of Rectangle3d
# ---------- python_3: Python ----------
import Rhino.Geometry as rg
import System
import ghpythonlib.treehelpers as th


def connect_two_points(pts, rect):
    if len(pts) == 2:
        def are_points_on_parallel_edges(pts, rect):
            tolerance = 0.01
            edges = rect.ToPolyline().GetSegments()

            for i in range(4):
                if (edges[i].DistanceTo(pts[0], True) < tolerance and
                    edges[(i+2) % 4].DistanceTo(pts[1], True) < tolerance):
                    return True

            return False

        def perpendicular_line_to_edge(point, rect):
            edges = rect.ToPolyline().GetSegments()
            closest_edge = min(edges, key=lambda edge: edge.DistanceTo(point, True))
            perp_vector = closest_edge.Direction
            # Rotate the vector by 90 degrees
            angle = System.Math.PI / 2  # 90 degrees in radians
            rotation = rg.Transform.Rotation(angle, rg.Vector3d.ZAxis, point)
            perp_vector.Transform(rotation)
            return rg.Line(point, point + perp_vector)

        if are_points_on_parallel_edges(pts, rect):
            return rg.Line(pts[0], pts[1])
        else:
            line1 = perpendicular_line_to_edge(pts[0], rect)
            line2 = perpendicular_line_to_edge(pts[1], rect)
            intersection_point, t1, t2 = rg.Intersect.Intersection.LineLine(line1, line2)
            if intersection_point:
                intersection = rg.Point3d((line1.PointAt(t1) + line2.PointAt(t2)) / 2)
                return rg.Line(pts[0], intersection), rg.Line(pts[1], intersection)
            else:
                return None

    return None

def connect_three_points(pts, rect):
    if len(pts) == 3:
        def are_points_on_parallel_edges(pts, rect):
            tolerance = 0.01  # 调整这个公差值
            edges = rect.ToPolyline().GetSegments()

            for i in range(4):
                if (edges[i].DistanceTo(pts[0], True) < tolerance and
                    edges[(i+2) % 4].DistanceTo(pts[1], True) < tolerance):
                    return pts[0], pts[1], pts[2], edges[i]
                elif (edges[i].DistanceTo(pts[1], True) < tolerance and
                    edges[(i+2) % 4].DistanceTo(pts[2], True) < tolerance):
                    return pts[1], pts[2], pts[0], edges[i]
                elif (edges[i].DistanceTo(pts[2], True) < tolerance and
                    edges[(i+2) % 4].DistanceTo(pts[0], True) < tolerance):
                    return pts[2], pts[0], pts[1], edges[i]

            return None, None, None, None

        pt1, pt2, pt3, edge = are_points_on_parallel_edges(pts, rect)
        if pt1 and pt2 and edge:
            line1 = rg.Line(pt1, pt2)
            
            edge_vector = edge.Direction
            line_help = rg.Line(pt3, pt3 + edge_vector)
            intersection = rg.Intersect.Intersection.LineLine(line1, line_help)
            if intersection[0]:
                point_of_intersection = line1.PointAt(intersection[1])
                line2 = rg.Line(pt3, point_of_intersection)
        
            return line1, line2
    else:
        return None

def connect_four_points(pts, rect):
    if len(pts) == 4:
        def sort_points_by_rectangle_edges(pts, rect):
            edges = rect.ToPolyline().GetSegments()
            sorted_pts = [None, None, None, None]

            for i in range(4):
                for j in range(4):
                    if edges[i].ClosestPoint(pts[j], False).DistanceTo(pts[j]) < 0.01:
                        sorted_pts[i] = pts[j]

            return sorted_pts

        if len(pts) != 4:
            return None, None  # 如果点的数量不是4个，返回None

        sorted_pts = sort_points_by_rectangle_edges(pts, rect)

        if sorted_pts[0] and sorted_pts[2]:
            line1 = rg.Line(sorted_pts[0], sorted_pts[2])
        else:
            line1 = None

        if sorted_pts[1] and sorted_pts[3]:
            line2 = rg.Line(sorted_pts[1], sorted_pts[3])
        else:
            line2 = None

        return line1, line2
    return None

def connect_points_all_case(pts, rects):
    tolerance = 0.01  # 调整容差值
    lines = []

    for rect in rects:
        edges = rect.ToPolyline().GetSegments()
        edge_points = []  # 存储在矩形上的点
        
        for pt in pts:
            for edge in edges:
                if edge.DistanceTo(pt, True) < tolerance:  # 计算点是否在矩形上
                    edge_points.append(pt)
        
        if len(edge_points) == 2:
            line = connect_two_points(edge_points, rect)
            lines.append(line)
        elif len(edge_points) == 3:
            line = connect_three_points(edge_points, rect)
            lines.append(line)
        elif len(edge_points) == 4:
            line = connect_four_points(edge_points, rect)
            lines.append(line)
    
    return lines

def output_rects(pts, rects):
    tolerance = 0.01  # 调整容差值
    output_rects = []

    for rect in rects:
        edges = rect.ToPolyline().GetSegments()
        edge_points = []  # 存储在矩形上的点
        
        for pt in pts:
            for edge in edges:
                if edge.DistanceTo(pt, True) < tolerance:  # 计算点是否在矩形上
                    edge_points.append(pt)

        if len(edge_points) == 2:
            output_rects.append(rect)
        elif len(edge_points) == 3:
            output_rects.append(rect)
        elif len(edge_points) == 4:
            output_rects.append(rect)
    
    return output_rects

# 输入点列表和矩形列表
pts = endPoints
rects = joint

jointCorridor = th.list_to_tree(connect_points_all_case(pts, rects))
jointBoundary = output_rects(pts, rects)
# ---------- end python_3 ----------

# ----
merge_2 = Merge(
    Data1=buildingboundary.buildingCorridor,
    Data2=buildingboundary_2.buildingCorridor,
    Data3=buildingboundary_4.buildingCorridor,
    Data4=buildingboundary_5.buildingCorridor,
    Data5=buildingboundary_3.buildingCorridor,
    Data6=buildingboundary_6.buildingCorridor,
    Data7=buildingboundary_7.buildingCorridor,
    Data8=buildingboundary_10.buildingCorridor,
    Data9=buildingboundary_8.buildingCorridor,
    Data10=buildingboundary_9.buildingCorridor,
    Data11=python_3.jointCorridor)
merge_3 = Merge(
    Data1=buildingboundary.buildingBoundary,
    Data2=buildingboundary_2.buildingBoundary,
    Data3=buildingboundary_3.buildingBoundary,
    Data4=buildingboundary_4.buildingBoundary,
    Data5=buildingboundary_5.buildingBoundary,
    Data6=buildingboundary_6.buildingBoundary,
    Data7=buildingboundary_7.buildingBoundary,
    Data8=buildingboundary_10.buildingBoundary,
    Data9=buildingboundary_8.buildingBoundary,
    Data10=buildingboundary_9.buildingBoundary,
    Data11=python_3.jointBoundary)  # -> flatten(Result)
merge_4 = Merge(
    Data1=buildingboundary.staircaseBoundary,
    Data2=buildingboundary_2.staircaseBoundary,
    Data3=buildingboundary_4.staircaseBoundary,
    Data4=buildingboundary_5.staircaseBoundary,
    Data5=buildingboundary_3.staircaseBoundary,
    Data6=buildingboundary_6.staircaseBoundary,
    Data7=buildingboundary_7.staircaseBoundary,
    Data8=buildingboundary_10.staircaseBoundary,
    Data9=buildingboundary_8.staircaseBoundary,
    Data10=buildingboundary_9.staircaseBoundary)
join = JoinCurves(Curves=merge_2, Preserve=False)
offset = OffsetCurve(Curve=join, Distance=1, Corners=1)
offset_2 = OffsetCurve(Curve=join, Distance=expr("x*(-1)", 1), Corners=1)
merge_5 = Merge(Data1=offset, Data2=offset_2)

# ---- group: WWR_XYaxis
merge_6 = Merge(
    Data1=buildingboundary.windowSetPoints,
    Data2=buildingboundary_2.windowSetPoints,
    Data3=buildingboundary_4.windowSetPoints,
    Data4=buildingboundary_5.windowSetPoints,
    Data5=buildingboundary_3.windowSetPoints,
    Data6=buildingboundary_6.windowSetPoints,
    Data7=buildingboundary_7.windowSetPoints,
    Data8=buildingboundary_10.windowSetPoints,
    Data9=buildingboundary_8.windowSetPoints,
    Data10=buildingboundary_9.windowSetPoints)
entwine = Entwine(
    Branch00=dispatch.ListA,
    Branch01=dispatch.ListB,
    Branch02=dispatch_2.ListA,
    Branch03=dispatch_2.ListB,
    Branch04=dispatch_4.ListA,
    Branch05=dispatch_4.ListB,
    Branch06=dispatch_5.ListA,
    Branch07=dispatch_5.ListB,
    Branch08=dispatch_3.ListA,
    Branch09=dispatch_3.ListB,
    Branch010=dispatch_6.ListA,
    Branch011=dispatch_6.ListB,
    Branch012=dispatch_7.ListA,
    Branch013=dispatch_7.ListB,
    Branch014=dispatch_10.ListA,
    Branch015=dispatch_10.ListB,
    Branch016=dispatch_8.ListA,
    Branch017=dispatch_8.ListB,
    Branch018=dispatch_9.ListA,
    Branch019=dispatch_9.ListB,
    FlattenInputs=True)

# ----
end = EndPoints(Curve=merge_5)  # -> Start, End
pline = PolyLine(Vertices=end.Start, Closed=False)
pline_2 = PolyLine(Vertices=end.End, Closed=False)
runion = RegionUnion(Curves=merge_3)
merge_7 = Merge(Data1=merge_5, Data2=pline, Data3=pline_2)  # -> flatten(Result)
boundary = BoundarySurfaces(Edges=runion)
len = Length(Curve=runion)
crv = Curve(simplify(entwine))

window_height_2 = Slider(0.8, range=0.8..2)
shading_type_2 = Slider(1, range=0..2)
shading_length_2 = Slider(0.5, range=0.1..1.1)
storey_number_2 = Slider(5, range=1..7)
storey_height_2 = Slider(2.7, range=2.5..3.5)
number_slider_2 = Slider(0, range=0..360)

join_2 = JoinCurves(Curves=merge_7, Preserve=False)
merge_8 = Merge(Data1=join_2, Data2=merge_4)
runion_2 = RegionUnion(Curves=merge_8)
boundary_2 = BoundarySurfaces(Edges=runion_2)
len_2 = Length(Curve=runion_2)
area = Area(Geometry=boundary_2)  # -> Area, Centroid
ma = MassAddition(Input=len_2)  # -> Result, PartialResults
ma_2 = MassAddition(Input=len)  # -> Result, PartialResults
area_2 = Area(Geometry=boundary)  # -> Area, Centroid
clean = CleanTree(RemoveNulls=True, RemoveInvalid=True, RemoveEmpty=True, Tree=crv)
sdiff = SolidDifference(BrepsA=boundary, BrepsB=boundary_2)
srf = Surface(boundary_2)
srf_2 = Surface(sdiff)
panel_2 = Panel(clean)
buildingperimeter = Panel(ma_2.Result)
buildingarea = Panel(area_2.Area)
corridorarea = Panel(area.Area)
corriodrperimeter = Panel(ma.Result)
entwine_2 = Entwine(Branch00=srf_2, Branch01=srf, FlattenInputs=True)
panel_3 = Panel(entwine_2)
X = UnitX(Factor=Slider(0, range=0..1000))

# ---- group: shading option
panel_4 = Panel(["0", "1", "2"])
panel_5 = Panel("1")
panel_6 = Panel(["0", "2"])

# ----
move = Move(Geometry=clean, Motion=X)  # -> Geometry, Transform
Z = UnitZ(Factor=Slider(0.4, range=-0.3..0.7))
move_2 = Move(Geometry=move.Geometry, Motion=Z)  # -> Geometry, Transform
Z_2 = UnitZ(Factor=window_height)
extr = Extrude(Base=move_2.Geometry, Direction=Z_2)

bang = ExplodeTree(Data=extr)  # -> Branch0, Branch1, Branch2, Branch3, Branch4, Branch5, Branch6, Branch7, Branch8, Branch9
merge_9 = Merge(Data1="0,0", Data2="0,1", Data3="0,2")
entwine_3 = Entwine(Branch00=panel_6, Branch01=panel_5, Branch02=panel_4, FlattenInputs=True)
edges = BrepEdges(Brep=bang.Branch1)  # -> Naked, Interior, NonManifold
edges_2 = BrepEdges(Brep=bang.Branch0)  # -> Naked, Interior, NonManifold
edges_3 = BrepEdges(Brep=bang.Branch2)  # -> Naked, Interior, NonManifold
edges_4 = BrepEdges(Brep=bang.Branch3)  # -> Naked, Interior, NonManifold
item_9 = ListItem(List=merge_9, Index=shading_type, Wrap=True)
branch = TreeBranch(Tree=entwine_3, Path=item_9, MaintainPaths=True)
Y = UnitY(Factor=expr("-x", shading_length))
X_2 = UnitX(Factor=expr("-x", shading_length))
item_10 = ListItem(List=edges_2.Naked, Index=branch, Wrap=True)
item_11 = ListItem(List=edges_3.Naked, Index=branch, Wrap=True)
item_12 = ListItem(List=edges_4.Naked, Index=branch, Wrap=True)
item_13 = ListItem(List=edges.Naked, Index=branch, Wrap=True)
X_3 = UnitX(Factor=shading_length)
Y_2 = UnitY(Factor=shading_length)
extr_2 = Extrude(Base=item_10, Direction=X_2)
extr_3 = Extrude(Base=item_11, Direction=X_2)
extr_4 = Extrude(Base=item_12, Direction=X_3)
extr_5 = Extrude(Base=item_13, Direction=X_3)

edges_5 = BrepEdges(Brep=bang.Branch4)  # -> Naked, Interior, NonManifold
edges_6 = BrepEdges(Brep=bang.Branch8)  # -> Naked, Interior, NonManifold
edges_7 = BrepEdges(Brep=bang.Branch5)  # -> Naked, Interior, NonManifold
edges_8 = BrepEdges(Brep=bang.Branch9)  # -> Naked, Interior, NonManifold
edges_9 = BrepEdges(Brep=bang.Branch6)  # -> Naked, Interior, NonManifold
edges_10 = BrepEdges(Brep=bang.Branch7)  # -> Naked, Interior, NonManifold
move_3 = Move(Geometry=entwine_2, Motion=X)  # -> Geometry, Transform
item_14 = ListItem(List=edges_5.Naked, Index=branch, Wrap=True)
item_15 = ListItem(List=edges_6.Naked, Index=branch, Wrap=True)
Y_3 = UnitY(Factor=shading_length)
item_16 = ListItem(List=edges_7.Naked, Index=branch, Wrap=True)
item_17 = ListItem(List=edges_8.Naked, Index=branch, Wrap=True)
item_18 = ListItem(List=edges_9.Naked, Index=branch, Wrap=True)
item_19 = ListItem(List=edges_10.Naked, Index=branch, Wrap=True)
extr_6 = Extrude(Base=item_15, Direction=Y_3)
extr_7 = Extrude(Base=item_16, Direction=Y)
extr_8 = Extrude(Base=item_14, Direction=Y_3)
extr_9 = Extrude(Base=item_17, Direction=Y)
extr_10 = Extrude(Base=item_18, Direction=Y_3)
extr_11 = Extrude(Base=item_19, Direction=Y)
rotate = Rotate(Geometry=move_3.Geometry, Angle=degrees(angle), Plane=PlaneXY(0, 0, 0))  # -> Geometry, Transform
rotate_2 = Rotate(
    Geometry=[extr_2, extr_5, extr_3, extr_4, extr_8, extr_7, extr_10, extr_11, extr_6, extr_9],
    Angle=degrees(angle),
    Plane=PlaneXY(0, 0, 0))  # -> Geometry, Transform
rotate_3 = Rotate(Geometry=extr, Angle=degrees(angle), Plane=PlaneXY(0, 0, 0))  # -> flatten(Geometry), Transform
bang_2 = ExplodeTree(Data=rotate.Geometry)  # -> Branch0, Branch1
Z_3 = UnitZ(Factor=storey_height)
srf_3 = Surface(bang_2.Branch0)
srf_4 = Surface(bang_2.Branch1)
panel_7 = Panel(rotate_3.Geometry)
extr_12 = Extrude(Base=srf_3, Direction=Z_3)
extr_13 = Extrude(Base=srf_4, Direction=Z_3)
sdiff_2 = SolidDifference(BrepsA=extr_12, BrepsB=extr_13)
panel_8 = Panel(extr_13)
cluster = Cluster(
    geo_2=rotate_2.Geometry,
    A_2=storey_height,
    x=storey_number,
    A=type,
    z_component=storey_height,
    B=colibri_in.INDEX,
    _0_0=sdiff_2,
    _0_1=extr_13,
    C=storey_number,
    geo=rotate_3.Geometry,
    B_2=wall_u_value,
    B_3=roof_u_value,
    B_4=floor_u_value,
    u_factor=window_u_value)
colibri_out = ColibriOutputs(
    BuildingArea=flatten(buildingarea),
    BuildingPerimeter=flatten(buildingperimeter),
    CorridorArea=flatten(corridorarea),
    CorriodrPerimeter=flatten(corriodrperimeter),
    WWR=flatten(cluster),
    SHADING_TYPE=flatten(shading_type),
    STOREY_NUMBER=flatten(storey_number),
    ANGLE=flatten(angle),
    storey_height=flatten(storey_height),
    shading_length=flatten(shading_length),
    window_height=flatten(window_height),
    WALL_U_VALUE=flatten(wall_u_value),
    ROOF_U_VALUE=flatten(roof_u_value),
    FLOOR_U_VALUE=flatten(floor_u_value),
    WINDOW_U_VALUE=flatten(window_u_value),
    TYPE=flatten(type))
ca = ColibriAggregator(Folder=panel, Inputs=colibri_in.IP, Outputs=colibri_out, Write=Toggle(False), recordingMode=0)

# ==== cluster NormalDistribution
D = ClusterInput()
N = ClusterInput()
range = Range(Domain=D, Steps=N)
avr = Average(Input=range)

# ---- group: standard deviation
tstat = TreeStatistics(Tree=range)  # -> Paths, Length, Count
subtraction = Subtraction(A=range, B=avr)
sqr = Square(Value=subtraction)
ma = MassAddition(Input=sqr)  # -> Result, PartialResults
division = Division(A=ma.Result, B=tstat.Length)
sqrt = SquareRoot(Value=division)
division_2 = Division(A=sqrt, B=2)

# ----
item = ListItem(List=range, Index=0, Wrap=True)
item_2 = ListItem(List=range, Index=-1, Wrap=True)
z = ClusterInput()
python = GhPythonScript(x=avr, y=division_2, a=item, b=item_2, z=z)  # -> out, a
# ---------- python: Python ----------
__author__ = "xinyuew"
__version__ = "2023.09.25"

import rhinoscriptsyntax as rs
 
import random
import math

# Define the parameters of the normal distribution
mean = x  # Mean (average) of the distribution
std_dev = y  # Standard deviation of the distribution
min_value = a  # Minimum value for the generated data
max_value = b  # Maximum value for the generated data
num_samples = z  # Number of random samples to generate

# Create an empty list to store the random values
random_values = []

# Generate random values following a normal distribution
for _ in range(int(num_samples)):
    # Generate two random numbers between 0 and 1
    u1 = random.random()
    u2 = random.random()
    
    # Use the Box-Muller transform to create normally distributed values
    z = math.sqrt(-2 * math.log(u1)) * math.cos(2 * math.pi * u2)
    
    # Scale and shift the value to match the desired mean and standard deviation
    x = mean + std_dev * z
    
    # Clip the value to the desired range (min_value to max_value)
    x = max(min(x, max_value), min_value)
    #x= a+
    # Append the generated value to the list
    random_values.append(x)
    
for i in random_values:
    print(i)
# Now, 'random_values' contains random numbers that follow a normal distribution with the specified mean and standard deviation
# ---------- end python ----------

# ---- group: 0.1
multiplication = Multiplication(A=python.out, B=10)
int = Integer(multiplication)
division_3 = Division(A=int, B=10)

# ----
R = ClusterOutput(division_3)

# ==== cluster Cluster
_0_0 = ClusterInput()
_0_1 = ClusterInput()
geo = ClusterInput()
u_factor = ClusterInput()
C = ClusterInput()
z_component = ClusterInput()
A = ClusterInput()
B = ClusterInput()
geo_2 = ClusterInput()
A_2 = ClusterInput()
x = ClusterInput()
B_2 = ClusterInput()
B_3 = ClusterInput()
B_4 = ClusterInput()

# ---- group: U VALUE
floor_u_value = Slider(0.15, range=0.1..0.2)
window_u_value = Slider(2, range=1..2)
roof_u_value = Slider(0.16, range=0.1..0.2)
wall_u_value = Slider(0.43, range=0.1..0.6)

# ----
division = Division(A=1, B=B_3)
division_2 = Division(A=1, B=B_4)
division_3 = Division(A=1, B=B_2)
opaquematnomass = HBOpaqueMaterialNoMass(r_value=division)  # -> mat; plug-in component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
opaquematnomass_2 = HBOpaqueMaterialNoMass(r_value=division_3)  # -> mat; plug-in component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
opaquematnomass_3 = HBOpaqueMaterialNoMass(r_value=division_2)  # -> mat; plug-in component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
opaqueconstr = HBOpaqueConstruction(name="Ext_Wall", materials=opaquematnomass_2)  # -> constr; plug-in component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
opaqueconstr_2 = HBOpaqueConstruction(name="Roof", materials=opaquematnomass)  # -> constr; plug-in component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
opaqueconstr_3 = HBOpaqueConstruction(name="Floor", materials=opaquematnomass_3)  # -> constr; plug-in component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
u_value_baseline = Panel("2.4")
baseline = Panel("window")
exteriorsubset = HBExteriorConstructionSubset(exterior_wall=opaqueconstr, exterior_roof=opaqueconstr_2)  # -> exterior_set; plug-in component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
groundsubset = HBGroundConstructionSubset(ground_floor=opaqueconstr_3)  # -> ground_set; plug-in component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
windowmat = HBWindowMaterial(name=baseline, u_factor=u_factor, shgc="0.5")  # -> mat; plug-in component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
constructionset = HBConstructionSet(exterior_subset=exteriorsubset, ground_subset=groundsubset)  # -> constr_set; plug-in component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
windowconstr = HBWindowConstruction(name="Windows", materials=windowmat)  # -> constr; plug-in component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
exterior_wall = Panel(opaqueconstr)
roof = Panel(opaqueconstr_2)
floor = Panel(opaqueconstr_3)
window = Panel(windowconstr)

number_slider = Slider(0.56, range=0..1)
hb_building_vintages = HBBuildingVintages({"ASHRAE 90.1 2013  |  IECC 2015": "2013", "ASHRAE 90.1 2010  |  IECC 2012": "2010", "ASHRAE 90.1 2007  |  IECC 2009": "2007", "ASHRAE 90.1 2004  |  IECC 2006": "2004", "1980-2004 (CBECS)": "1980_2004", "Pre-1980 (CBECS)": "pre_1980"}, selected="ASHRAE 90.1 2013  |  IECC 2015")
hb_building_programs = HBBuildingPrograms({"LargeOffice", "MediumOffice", "SmallOffice", "MidriseApartment", "HighriseApartment", "Retail", "StripMall", "PrimarySchool", "SecondarySchool", "SmallHotel", "LargeHotel", "Hospital", "Outpatient", "Laboratory", "Warehouse", "SuperMarket", "FullServiceRestaurant", "QuickServiceRestaurant", "Courthouse", "LargeDataCenterHighITE", "LargeDataCenterLowITE", "SmallDataCenterHighITE", "SmallDataCenterLowITE"}, selected="MidriseApartment")
weeklyschedule = HBWeeklySchedule(
    sun=number_slider,
    mon=number_slider,
    tue=number_slider,
    wed=number_slider,
    thu=number_slider,
    fri=number_slider,
    sat=number_slider,
    holiday=number_slider)  # -> report, schedule, idf_year, idf_week, idf_days; plug-in component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
searchprog = HBSearchPrograms(bldg_prog=hb_building_programs, vintage=hb_building_vintages, keywords="apartment")  # -> room_prog; plug-in component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
deconstrprogram = HBDeconstructProgramType(program=searchprog)  # -> people, lighting, electric_equip, gas_equip, hot_water, infiltration, ventilation, setpoint; plug-in component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
decnstrpeople = HBDeconstructPeople(people=deconstrprogram.people)  # -> name, ppl_per_area, occupancy_sch, activity_sch; plug-in component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
decnstrinfiltration = HBDeconstructInfiltration(infil=deconstrprogram.infiltration)  # -> name, flow_per_ext_area, schedule; plug-in component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
decnstrequipment = HBDeconstructEquipment(equip=deconstrprogram.electric_equip)  # -> name, watts_per_area, schedule, radiant_fract, latent_fract, lost_fract, is_gas; plug-in component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
division_4 = Division(A=1, B="36")
people = HBPeople(ppl_per_area=division_4, occupancy_sch=weeklyschedule.schedule)  # -> people; plug-in component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
applysetpointvals = HBApplySetpointValues(room_or_program=flatten(searchprog), cooling_setpt="80", heating_setpt="21")  # -> report, mod_obj; plug-in component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
panel = Panel(decnstrinfiltration.flow_per_ext_area)
applysetpointvals_2 = HBApplySetpointValues(room_or_program=flatten(searchprog), cooling_setpt="80", heating_setpt="10")  # -> report, mod_obj; plug-in component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
panel_2 = Panel(decnstrequipment.watts_per_area)
deconstrprogram_2 = HBDeconstructProgramType(program=applysetpointvals.mod_obj)  # -> people, lighting, electric_equip, gas_equip, hot_water, infiltration, ventilation, setpoint; plug-in component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
deconstrprogram_3 = HBDeconstructProgramType(program=applysetpointvals_2.mod_obj)  # -> people, lighting, electric_equip, gas_equip, hot_water, infiltration, ventilation, setpoint; plug-in component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
equipment = HBEquipment(
    name="CustomEquipment",
    watts_per_area="3.424071221",
    schedule=weeklyschedule.schedule,
    radiant_fract=decnstrequipment.radiant_fract,
    latent_fract=decnstrequipment.latent_fract,
    lost_fract=decnstrequipment.lost_fract,
    gas=decnstrequipment.is_gas)  # -> equip; plug-in component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
infiltration = HBInfiltration(name="infiltration_Current", flow_per_ext_area="0.0006", schedule=decnstrinfiltration.schedule)  # -> infil; plug-in component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
ventilation = HBVentilation(name="minimum ventilation", flow_per_area="0.0005", schedule=weeklyschedule.schedule)  # -> vent; plug-in component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
programtype = HBProgramType(
    name="zone 01 program",
    base_program=searchprog,
    people=people,
    electric_equip=equipment,
    hot_water=deconstrprogram.hot_water,
    infiltration=infiltration,
    ventilation=ventilation,
    setpoint=deconstrprogram_2.setpoint)  # -> program; plug-in component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
deconstrprogram_4 = HBDeconstructProgramType(program=programtype)  # -> people, lighting, electric_equip, gas_equip, hot_water, infiltration, ventilation, setpoint; plug-in component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
programtype_2 = HBProgramType(
    name="zone 02 program",
    base_program=searchprog,
    people=people,
    electric_equip=equipment,
    hot_water=deconstrprogram.hot_water,
    infiltration=infiltration,
    ventilation=ventilation,
    setpoint=deconstrprogram_3.setpoint)  # -> program; plug-in component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
deconstrprogram_5 = HBDeconstructProgramType(program=programtype_2)  # -> people, lighting, electric_equip, gas_equip, hot_water, infiltration, ventilation, setpoint; plug-in component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
panel_3 = Panel(deconstrprogram_5.setpoint)
panel_4 = Panel(deconstrprogram_4.setpoint)

boolean_toggle = BooleanToggle(True)
entwine = Entwine(Branch00=_0_0, Branch01=_0_1, FlattenInputs=True)
intsolid = HBIntersectSolids(solids=flatten(entwine), parallel=boolean_toggle, run=boolean_toggle)  # -> int_solids; plug-in component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
unflatten_tree = UnflattenTree(Tree=intsolid, Guide=entwine)
explode_tree = ExplodeTree(Data=unflatten_tree)  # -> Branch0, Branch1
roomsolid = HBRoomFromSolid(geo=flatten(explode_tree.Branch0), name="zone 01", program=programtype, conditioned=True)  # -> report, rooms; plug-in component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
roomsolid_2 = HBRoomFromSolid(geo=flatten(explode_tree.Branch1), name="zone 02", program=programtype_2, conditioned=True)  # -> report, rooms; plug-in component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

number_slider_2 = Slider(6, range=1..7)
doas = HBDOASHVACTemplates({"DOAS with fan coil chiller with boiler": "DOAS_FCU_Chiller_Boiler", "DOAS with fan coil chiller with central air source heat pump": "DOAS_FCU_Chiller_ASHP", "DOAS with fan coil chiller with district hot water": "DOAS_FCU_Chiller_DHW", "DOAS with fan coil chiller with baseboard electric": "DOAS_FCU_Chiller_ElectricBaseboard", "DOAS with fan coil chiller with gas unit heaters": "DOAS_FCU_Chiller_GasHeaters", "DOAS with fan coil chiller with no heat": "DOAS_FCU_Chiller", "DOAS with fan coil air-cooled chiller with boiler": "DOAS_FCU_ACChiller_Boiler", "DOAS with fan coil air-cooled chiller with central air source heat pump": "DOAS_FCU_ACChiller_ASHP", "DOAS with fan coil air-cooled chiller with district hot water": "DOAS_FCU_ACChiller_DHW", "DOAS with fan coil air-cooled chiller with baseboard electric": "DOAS_FCU_ACChiller_ElectricBaseboard"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}, selected="DOAS with fan coil chiller with boiler")
panel_5 = Panel("C:\Users\xinyuew\OneDrive - Chalmers\haohaoxuexi\shits for paper No.2\colibri\first1000\E\idf")
concat = Concatenate(FragmentH="\", FragmentA=A, FragmentB=B)
panel_6 = Panel(concat)
concat_2 = Concatenate(FragmentA=panel_5, FragmentB=concat, FragmentC=".idf")
panel_7 = Panel(concat_2)
toggle = BooleanToggle(False)
path = FilePath("C:\Users\xinyuew\OneDrive - Chalmers\haohaoxuexi\sensitivity analysis and case study\tool 2nd version\Uddevalla2017EPWv2.epw")

applyconstrset = HBApplyConstructionSet(rooms=roomsolid_2.rooms, constr_set=constructionset)  # -> rooms; plug-in component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
applyconstrset_2 = HBApplyConstructionSet(rooms=roomsolid.rooms, constr_set=constructionset)  # -> rooms; plug-in component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
idealair = HBIdealAir(rooms=flatten(applyconstrset))  # -> out, rooms; plug-in component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
panel_8 = Panel(applyconstrset_2)
idealair_2 = HBIdealAir(rooms=flatten(applyconstrset_2))  # -> out, rooms; plug-in component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
panel_9 = Panel(applyconstrset)
applysetpointvals_3 = HBApplySetpointValues(room_or_program=flatten(idealair.rooms), heating_setpt="0")  # -> out, mod_obj; plug-in component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
applysetpointvals_4 = HBApplySetpointValues(room_or_program=flatten(idealair_2.rooms), heating_setpt="21")  # -> out, mod_obj; plug-in component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
vector_xyz = VectorXYZ(XComponent=0, YComponent=0, ZComponent=z_component)  # -> Vector, Length
solveadj = HBSolveAdjacency(rooms=flatten([applysetpointvals_3.mod_obj, applysetpointvals_4.mod_obj]), run=Toggle(True))  # -> out, adj_rooms; plug-in component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
aperture = HBAperture(geo=geo, name="Windows_Orignial", ep_constr=windowconstr)  # -> out, apertures; plug-in component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
addsubface = HBAddSubface(hb_obj=flatten(solveadj.adj_rooms), sub_faces=flatten(aperture.apertures))  # -> hb_obj; plug-in component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

doashvac = HBDOASHVAC(rooms=flatten(applyconstrset_2), system_type=doas, sensible_hr="0.5")  # -> report, rooms; plug-in component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

# ---- group: shading
python = GhPythonScript(x=x)  # -> out, a
# ---------- python: Python ----------
__author__ = "xinyuew"
__version__ = "2023.04.06"

import rhinoscriptsyntax as rs
a=[]
for i in range(0,int(x)):
    a.append(i)
    a
a
# ---------- end python ----------
multiplication = Multiplication(A=A_2, B=python.a)
geo_3 = Geometry(geo_2)
Z = UnitZ(Factor=multiplication)
move = Move(Geometry=graft(geo_3), Motion=Z)  # -> Geometry, Transform
shade = HBShade(geo=flatten(move.Geometry))  # -> report, shades; plug-in component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
addshade = HBAddShade(hb_obj=addsubface, out_shades=flatten(shade.shades))  # -> hb_obj; plug-in component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

# ----
series = Series(Start=0, Step=1, Count=C)
multiplication_2 = Multiplication(A=vector_xyz.Vector, B=series)
concat_3 = Concatenate(FragmentA="Story", FragmentB=series)  # -> simplify(graft(Result))

concatenate = Concatenate(FragmentA=series, FragmentB="_floor")
move_2 = HBMove(hb_objs=flatten(addsubface), vector=multiplication_2, prefix=concatenate)  # -> hb_objs; plug-in component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
setstory = HBSetStory(rooms=move_2, story=concat_3)  # -> out, rooms; plug-in component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

solveadj_2 = HBSolveAdjacency(rooms=flatten(setstory.rooms), run=Toggle(True))  # -> report, adj_rooms; plug-in component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

# ---- group: Visualize Stories
roomattr = HBRoomAttributes({"Display Name": "display_name", "Simulation Name (Identifier)": "identifier", "Multiplier": "multiplier", "Story": "story", "Volume": "volume", "Gross Floor Area": "floor_area", "Exposed Area": "exposed_area", "Exterior Wall Area": "exterior_wall_area", "Exterior Aperture Area": "exterior_aperture_area", "Average Floor Elevation": "average_floor_height"}, selected="Story")
vizquick = HBVizualizeQuick(hb_objs=flatten(solveadj_2.adj_rooms))  # -> geo; plug-in component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
colorroomattr = HBColorRoomAttributes(rooms_model=flatten(solveadj_2.adj_rooms), attribute=roomattr)  # -> mesh, legend, wire_frame, values, colors; plug-in component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
preview = CustomPreview(Geometry=vizquick, Material=colorroomattr.colors)

# ---- group: Visualize Boundary Conditions
vizbybc = HBVizualizeByBC(rooms=solveadj_2.adj_rooms)  # -> outdoors, surface, ground, adiabatic, other, wire_frame; plug-in component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
geo_4 = Geometry(vizbybc.surface)
geo_5 = Geometry(vizbybc.adiabatic)
geo_6 = Geometry(vizbybc.wire_frame)

# ----
panel_10 = Panel(solveadj_2.adj_rooms)
panel_11 = Panel(vizquick)

# ----
# C:\Users\xinyuew\OneDrive - Chalmers\haohaoxuexi\sensitivity analysis and case study\tool 2nd version\Uddevalla2017EPWv2.epw
panel_12 = Panel("Parametric_sim")
concatenate_2 = Concatenate(FragmentA=panel_12)
model = HBModel(rooms=flatten(solveadj_2.adj_rooms), shades=flatten(shade.shades), name=concatenate_2)  # -> out, model; plug-in component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
modeltoosm = HBModelToOSM(model=model.model, epw_file=path, write=Toggle(False), run=Slider(2, range=0..10))  # -> report, jsons, osw, osm, idf, sql, zsz, rdd, html; plug-in component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
panel_13 = Panel(modeltoosm.idf)
panel_14 = Panel(modeltoosm.jsons)
eui = HBEndUseIntensity(sql=modeltoosm.sql)  # -> eui, eui_end_use, end_uses, gross_floor; plug-in component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
concatenate_3 = Concatenate(Fragment_A=eui.end_uses, A=" : ", Fragment_B=eui.eui_end_use, B=" kWh/m2")
item = ListItem(List=eui.eui_end_use, Index=0, Wrap=True)
heating_kwh = Number(item)
panel_15 = Panel(concatenate_3)
heating_kwh_m2 = Panel(heating_kwh)

python_2 = GhPythonScript(src=modeltoosm.idf, dst=concat_2)  # -> out, a
# ---------- python_2: Python ----------
__author__ = "fojacob"
__version__ = "2023.03.09"

import rhinoscriptsyntax as rs
import shutil

shutil.copyfile(src,dst)

a = dst
# ---------- end python_2 ----------
idf = Panel(python_2.a)
vizbytype = HBVisualizeByType(hb_objs=model.model)  # -> out, walls, interior_walls, roofs, ceilings, exterior_floors, interior_floors, air_walls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; plug-in component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
geo_7 = Geometry(vizbytype.walls)
geo_8 = Geometry(vizbytype.apertures)
area = Area(Geometry=geo_7)  # -> Area, Centroid
area_2 = Area(Geometry=geo_8)  # -> Area, Centroid
division_5 = Division(A=area_2.Area, B=area.Area)
multiplication_3 = Multiplication(A=division_5, B=100)
int = Integer(multiplication_3)
division_6 = Division(A=int, B=100)
wwr = Panel(division_6)
wwr_2 = ClusterOutput(wwr)
